test file "Test_CruiseControl_project"

suite "New Test Suite 1"

  case "SoC_handle_FSM_BaselineTest" [baseline]
    model Bozza_longitudinal_rev2_19b, harness Bozza_longitudinal_rev2_19b_Harness3 (for Bozza_longitudinal_rev2_19b/Chart), stop time 10
    input "Test_chart_rev2.mat", mapped to SoC (active)
    logged signals "Signal Set 1": P_PID, I_PID, D_PID, OutOfRange
    baseline "Baseline_FSM_Testing_rev2.mat"
      D_PID
      I_PID
      OutOfRange
      P_PID
    baseline "Baseline_FSM_Testing_rev3_captured.mat" (0 of 8 signals compared)
    baseline "Baseline_FSM_Testing_rev4_captured.mat": backward time tol 0.15
      D_PID
      I_PID
      OutOfRange
      P_PID
      P_PID_:1
      I_PID_:1
      D_PID_:1
      OutOfRange