test file "Test_CruiseControl_project"

suite "New Test Suite 1"

  case "SoC_handle_FSM_BaselineTest" [baseline]
    model Bozza_longitudinal_rev2_19b, harness Bozza_longitudinal_rev2_19b_Harness3 (for Bozza_longitudinal_rev2_19b/Chart), stop time 10
    input "Test_chart_rev2.mat", mapped to SoC (active)
    logged signals "Signal Set 1": P_PID, I_PID, D_PID, OutOfRange
    baseline "Baseline_FSM_Testing_rev2.mat" (0 of 4 signals compared)
    baseline "Baseline_FSM_Testing_rev3_captured.mat" (0 of 8 signals compared)
    baseline "Baseline_FSM_Testing_rev4_captured.mat": backward time tol 0.15
      D_PID
      I_PID
      OutOfRange
      P_PID
      P_PID_:1
      I_PID_:1
      D_PID_:1
      OutOfRange

  case "Integration_test" [simulation]

  case "Switch_test" [baseline]
    model Bozza_longitudinal_rev2_19b, harness Bozza_longitudinal_rev2_19b_Harness1 (for Bozza_longitudinal_rev2_19b/controller/Switch_Subsystem), stop time 5
    input "Test_switch_controller_input.mat", mapped to Target_speed, acceptable_speed (active)
    logged signals "Signal Set 1": Final_target
    baseline "Baseline_switch_controller.mat": forward time tol 0.1, backward time tol 0.08
      Final_target
      T/F
      Final target:1

  case "Torque_split_test" [baseline]
    model Bozza_longitudinal_rev2_19b, harness Bozza_longitudinal_rev2_19b_TorqueSplit_Harness2 (for Bozza_longitudinal_rev2_19b/Subsystem/Torque_split_Subsystem)
    input "Test_TorqueSplit_input.mat", mapped to Req_torque (active)
    baseline "Baseline_TorqueSplit.mat"
      Brake_torque
      Engine_torque:1
      Brake_torque:1